# Grasshopper definition 2024-12-26_open-brep-fix.gh (Grasshopper 1.0.8)
# plug-ins: RhinoCodePluginGH

site = Brep()
# Inputs
massing = Brep()
avg_level_height = Slider(5.33, range=0..10)

tstat = TreeStatistics(Tree=massing)  # -> Paths, Length, Count
# Getting the Top Face of the Breps
the_top_level = ListItem(List=massing, Index=0, Wrap=True)  # -> flatten(Item)
txt = Text(the_top_level)
py3 = Python3Script(x=txt)  # -> out, a
# ---------- py3: Python ----------
if "Open" in x:
    a=False
else:
    a=True
# ---------- end py3 ----------
mindex = MemberIndex(Set=py3.a, Member=Toggle(True))  # -> Index, Count
item = ListItem(List=tstat.Paths, Index=mindex.Index, Wrap=True)
branch = TreeBranch(Tree=massing, Path=item, MaintainPaths=False)
dispatch = Dispatch(List=the_top_level, DispatchPattern=py3.a)  # -> ListA, ListB
brep = Brep(dispatch.ListB)
cap = CapHoles(Brep=brep)

# ----
# Fixing the Open Breps
debrep = DeconstructBrep(Brep=cap)  # -> Faces, Edges, Vertices
area = Area(Geometry=debrep.Faces)  # -> Area, Centroid
evalsrf = EvaluateSurface(Surface=debrep.Faces, Point=area.Centroid)  # -> Point, Normal, UDirection, VDirection, Frame
unit = UnitVector(Vector=evalsrf.Normal)
devec = DeconstructVector(Vector=unit)  # -> XComponent, YComponent, ZComponent
# These Numbers need to be adjusted. They are the number of horizental faces in each of the input breps.
number_slider = Slider(4, range=0..100)
abs = Absolute(Value=devec.ZComponent)
larger = LargerThan(FirstNumber=abs, SecondNumber=0.9)  # -> LargerThan, OrEqualTo
cull = CullPattern(List=debrep.Faces, CullPattern=larger.LargerThan)
tstat_2 = TreeStatistics(Tree=cull)  # -> Paths, Length, Count
int = Integer(number_slider)
int_2 = Integer(Slider(0, range=0..100))
int_3 = Integer(Slider(1, range=0..100))
mindex_2 = MemberIndex(Set=tstat_2.Length, Member=int)  # -> Index, Count
mindex_3 = MemberIndex(Set=tstat_2.Length, Member=int_2)  # -> Index, Count
mindex_4 = MemberIndex(Set=tstat_2.Length, Member=int_3)  # -> Index, Count
item_2 = ListItem(List=tstat_2.Paths, Index=mindex_2.Index, Wrap=True)
item_3 = ListItem(List=tstat_2.Paths, Index=mindex_3.Index, Wrap=True)
item_4 = ListItem(List=tstat_2.Paths, Index=mindex_4.Index, Wrap=True)
branch_2 = TreeBranch(Tree=cull, Path=item_2, MaintainPaths=True)
# In this project the corresponding 3d brep trees were empty and the problem was solved manually in rhino
branch_3 = TreeBranch(Tree=debrep.Faces, Path=item_3, MaintainPaths=True)
branch_4 = TreeBranch(Tree=cull, Path=item_4, MaintainPaths=True)
area_2 = Area(Geometry=branch_2)  # -> Area, Centroid
pdecon = Deconstruct(Point=area_2.Centroid)  # -> XComponent, YComponent, ZComponent
sort = SortList(Keys=pdecon.ZComponent, ValuesA=branch_2)  # -> Keys, ValuesA
item_5 = ListItem(List=sort.ValuesA, Index=-1, Wrap=True)
merge = Merge(Data1=flatten(item_5), Data2=flatten(branch_4))

# ----
# Extruding the Open Breps
srf = Surface(merge)
area_3 = Area(Geometry=srf)  # -> Area, Centroid
project = ProjectPoint(Point=area_3.Centroid, Direction=Vector(0, 0, -1), Geometry=site)  # -> Point, Index
pt = Point(project.Point)
dist = Distance(PointA=area_3.Centroid, PointB=pt)
division = Division(A=dist, B=avg_level_height)
addition = Addition(A=dist, B=1)
int_4 = Integer(division)
division_2 = Division(A=addition, B=int_4)
multiplication = Multiplication(A=division_2, B=-1)
Z = UnitZ(Factor=multiplication)
series = Series(Start=0, Step=multiplication, Count=int_4)
extr = Extrude(Base=srf, Direction=Z)
graft = GraftTree(Tree=extr, IncludeEmptyLists=True, IncludeNullItems=True)
Z_2 = UnitZ(Factor=series)
move = Move(Geometry=graft, Motion=Z_2)  # -> simplify(Geometry), Transform
brep_2 = Brep(move.Geometry)
brep_3 = Brep(simplify(branch))
path_mapper = PathMapper(brep_2, source="{a}", target="{a+3279}")
merge_2 = Merge(Data1=path_mapper, Data2=brep_3)
