# Grasshopper definition 2024-12-28_mesh-to-networksrf.gh (Grasshopper 1.0.8)
# plug-ins: MeshEdit Components

# The components are disabled; I suggest to enable them one group at a time.
# Inputs
# 1st way
# appropriate for quadmesh networks that resemble a networksrf.
# For this one to work, you need to have the "mesh edit" plugin installed.
# Inputs
mesh = Mesh(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)  # disabled

# ----
# Getting the mesh grids
explode = MeshExplode(Mesh=mesh, Interpolate=False)  # disabled
demesh = DeconstructMesh(Mesh=explode)  # -> Vertices, Faces, Colours, Normals; disabled
item = ListItem(List=demesh.Vertices, Index=0, Wrap=True)  # -> Item, Item1, Item2, Item3; disabled
ln = Line(StartPoint=item.Item, EndPoint=item.Item1)  # disabled
ln_2 = Line(StartPoint=item.Item1, EndPoint=item.Item2)  # disabled
ln_3 = Line(StartPoint=item.Item3, EndPoint=item.Item2)  # disabled
ln_4 = Line(StartPoint=item.Item, EndPoint=item.Item3)  # disabled
join = JoinCurves(Curves=flatten(ln), Preserve=False)  # disabled
join_2 = JoinCurves(Curves=flatten(ln_2), Preserve=False)  # disabled
join_3 = JoinCurves(Curves=flatten(ln_3), Preserve=False)  # disabled
join_4 = JoinCurves(Curves=flatten(ln_4), Preserve=False)  # disabled

# ----
# 2nd way
number_of_crvs_in_u_direction = Slider(40, range=1..50)  # disabled
number_of_crvs_in_v_direction = Slider(30, range=1..50)  # disabled
mesh_2 = Mesh(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)  # disabled

# ----
# make sure that this polygon / curve is closed
# and consists of 4 lines / seperateble curves.
# 
# Also make sure that in the Top view at rhino,
# this polygon / curve is inside your mesh
# (Your mesh should contain this entire curve.
crv = Curve(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)  # disabled

# ----
# Making the Network Surface
panel = Panel("0")  # disabled
item_2 = ListItem(List=join, Index=panel, Wrap=True)  # disabled
item_3 = ListItem(List=join_4, Index=panel, Wrap=True)  # disabled
rev = ReverseList(List=join_2)  # disabled
merge = Merge(Data1=item_2, Data2=join_3)  # disabled
merge_2 = Merge(Data1=item_3, Data2=rev)  # disabled
netsurf = NetworkSurface(CurvesU=merge, CurvesV=merge_2, Continuity=2)  # disabled

# ----
# Creating a point grid
explode_2 = Explode(Curve=crv, Recursive=True)  # -> Segments, Vertices; disabled
item_4 = ListItem(List=explode_2.Segments, Index=0, Wrap=True)  # -> Item, Item1, Item2; disabled
flip = FlipCurve(Curve=item_4.Item2)  # -> Curve, Flag; disabled
divide = DivideCurve(Curve=item_4.Item, Count=number_of_crvs_in_u_direction, Kinks=False)  # -> Points, Tangents, Parameters; disabled
divide_2 = DivideCurve(Curve=flip.Curve, Count=number_of_crvs_in_u_direction, Kinks=False)  # -> Points, Tangents, Parameters; disabled
ln_5 = Line(StartPoint=divide.Points, EndPoint=divide_2.Points)  # disabled
# Projecting the points
# on the mesh
divide_3 = DivideCurve(Curve=ln_5, Count=number_of_crvs_in_v_direction, Kinks=False)  # -> Points, Tangents, Parameters; disabled

# ----
# Outputs
srf = Surface(netsurf)  # disabled

Z = UnitZ(Factor=1)  # disabled
project = ProjectPoint(Point=divide_3.Points, Direction=Z, Geometry=mesh_2)  # -> Point, Index; disabled

flip_2 = FlipMatrix(Data=project.Point)  # disabled
# Creating the Networksrf
intcrv = Interpolate(Vertices=project.Point, Degree=3, Periodic=False, KnotStyle=1)  # -> Curve, Length, Domain; disabled
intcrv_2 = Interpolate(Vertices=flip_2, Degree=3, Periodic=False, KnotStyle=1)  # -> Curve, Length, Domain; disabled
flatten = FlattenTree(Tree=intcrv.Curve, Path="{0}")  # disabled
flatten_2 = FlattenTree(Tree=intcrv_2.Curve, Path="{0}")  # disabled
# Outputs
netsurf_2 = NetworkSurface(CurvesU=flatten, CurvesV=flatten_2, Continuity=2)  # disabled

srf_2 = Surface(netsurf_2)  # disabled
